# Grasshopper definition DrawCrossSection.gh (Grasshopper 1.0.7)
# plug-ins: DBDMANGT

number_slider = Slider(5, range=0..10)
number_slider_2 = Slider(7, range=0..10)
srf = Surface(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)

number_slider_3 = Slider(0.01, range=0..0.01)
xy = XYPlane(Origin=Point(0, 0, 0))
draw_cross_section = DrawPlanarCrossSection(
    Height=Slider(0.5, range=-0.5..0.5),
    Width=Slider(0.2, range=0..0.2),
    TopThickness=number_slider_3,
    BottomThickness=number_slider_3,
    WallThickness=number_slider_3,
    Plane=xy)

mesh_uv = MeshSurface(Surface=srf, UCount=number_slider, VCount=number_slider_2, Overhang=True, Equalize=False)
demesh = DeconstructMesh(Mesh=mesh_uv)  # -> Vertices, Faces, Colours, Normals
uvmeshcreate = UVMeshCreate(NU=number_slider, NV=number_slider_2, Points=demesh.Vertices, FaceIndex=Slider(1, range=0..1))
