# Grasshopper definition Laplacian Smoothing.gh (Grasshopper 1.0.7)
# plug-ins: DesignbyData

srf = Surface(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)
number_slider = Slider(200, range=0..200)
mesh_uv = MeshSurface(Surface=srf, UCount=Slider(10, range=3..30), VCount=Slider(16, range=0..20), Overhang=True, Equalize=False)
number_slider_2 = Slider(1, range=0.1..1)

tri = Triangulate(Mesh=mesh_uv)  # -> Mesh, Count

lapsmooth = LaplacianSmoothing(Mesh=tri.Mesh, NStep=number_slider, Lambda=number_slider_2)  # disabled

lapsmooth_2 = LaplacianSmoothing(Mesh=tri.Mesh, NStep=number_slider, Lambda=number_slider_2)
